# Grasshopper definition anna.gh (Grasshopper 1.0.7)
# plug-ins: LunchBox

path = FilePath("C:\Users\Renato\OneDrive\github\especializacao_usp\artificial_neural_network\winequality-red.csv")

# ----
# I replaced these and set thenew path
file = ReadFile(F=path, PerLineParse=True)  # -> C
#   port F: Uri of file to read
# ---------- file: VB line parser ----------
    action = GH_LineParserAction.Include
    Return line

    'Parse the line and return some data that represents the line.
    'If the line cannot be parsed, you can return Nothing and
    'assign a different action.
    'The default implementation is to just return the line itself.
    'If you return types that implement IGH_Goo, this component
    'will work substantially faster.
# ---------- end file ----------

split = StringSplit(String=file, Separators=",")
panel = Panel(file)
panel_2 = Panel(split)
flip = FlipMatrix(Data=split)
bang = ExplodeTree(Data=flip)  # -> Branch0, Branch1, Branch2, Branch3, Branch4, Branch5, Branch6, Branch7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
random_split_list = RandomSplitList(MasterList=bang.Branch0, Seed=2, Split=0.3)  # -> ListA, ListB
random_split_list_2 = RandomSplitList(MasterList=bang.Branch1, Seed=2, Split=0.3)  # -> ListA, ListB
random_split_list_3 = RandomSplitList(MasterList=bang.Branch2, Seed=2, Split=0.3)  # -> ListA, ListB
random_split_list_4 = RandomSplitList(MasterList=bang.Branch3, Seed=2, Split=0.3)  # -> ListA, ListB
panel_3 = Panel("PRECISA PADRONIZAR")

panel_4 = Panel(bang.Branch0)
panel_5 = Panel(bang.Branch1)
panel_6 = Panel(bang.Branch2)
panel_7 = Panel(bang.Branch3)
panel_8 = Panel(bang.Branch4)
panel_9 = Panel(bang.Branch5)
panel_10 = Panel(bang.Branch6)
panel_11 = Panel(bang.Branch7)
panel_12 = Panel(bang.Branch8)
panel_13 = Panel(bang.Branch9)
panel_14 = Panel(bang.Branch10)

random_split_list_5 = RandomSplitList(MasterList=bang.Branch4, Seed=2, Split=0.3)  # -> ListA, ListB
random_split_list_6 = RandomSplitList(MasterList=bang.Branch5, Seed=2, Split=0.3)  # -> ListA, ListB
random_split_list_7 = RandomSplitList(MasterList=bang.Branch6, Seed=2, Split=0.3)  # -> ListA, ListB
random_split_list_8 = RandomSplitList(MasterList=bang.Branch7, Seed=2, Split=0.3)  # -> ListA, ListB
random_split_list_9 = RandomSplitList(MasterList=bang.Branch8, Seed=2, Split=0.3)  # -> ListA, ListB
random_split_list_10 = RandomSplitList(MasterList=bang.Branch9, Seed=2, Split=0.3)  # -> ListA, ListB
random_split_list_11 = RandomSplitList(MasterList=bang.Branch10, Seed=2, Split=0.3)  # -> ListA, ListB

panel_15 = Panel(random_split_list.ListA)
panel_16 = Panel(random_split_list_2.ListA)
panel_17 = Panel(random_split_list_3.ListA)
panel_18 = Panel(random_split_list_4.ListA)
panel_19 = Panel(random_split_list_5.ListA)
panel_20 = Panel(random_split_list_6.ListA)
panel_21 = Panel(random_split_list_7.ListA)
panel_22 = Panel(random_split_list_8.ListA)
panel_23 = Panel(random_split_list_9.ListA)
panel_24 = Panel(random_split_list_10.ListA)
panel_25 = Panel(random_split_list_11.ListA)

panel_26 = Panel(random_split_list.ListB)
panel_27 = Panel(random_split_list_2.ListB)
panel_28 = Panel(random_split_list_3.ListB)
panel_29 = Panel(random_split_list_4.ListB)
panel_30 = Panel(random_split_list_5.ListB)
panel_31 = Panel(random_split_list_6.ListB)
panel_32 = Panel(random_split_list_7.ListB)
panel_33 = Panel(random_split_list_8.ListB)
panel_34 = Panel(random_split_list_9.ListB)
panel_35 = Panel(random_split_list_10.ListB)
panel_36 = Panel(random_split_list_11.ListB)

random_split_list_12 = RandomSplitList(MasterList=bang.Branch11, Seed=2, Split=0.3)  # -> ListA, ListB
panel_37 = Panel(bang.Branch11)
panel_38 = Panel(random_split_list_12.ListA)
panel_39 = Panel(random_split_list_12.ListB)
